# Dynamo graph Floors - Create Including Doors & Windows_script.dyn "Floors - Create Including Doors & Windows" (Dynamo 2.6.1.8786)
# packages: WombatDynamo 1.3.2, spring nodes 203.2.0, archi-lab.net 2021.25.15, Clockwork for Dynamo 2.x 2.3.0, Data-Shapes 2021.2.91, IPArchitects 0.0.1

# group: COLLECT LEVELS FOR INPUT
code_block = CodeBlock { "Select Levels"; }
categories = Categories("OST_Levels")
all_elements_of_category = ElementsOfCategory(Category=categories)
code_block_2 = CodeBlock { "Name"; }
getParameterValueByName = Element.GetParameterValueByName(element=all_elements_of_category, parameterName=code_block_2)
boolean = BoolSelector(false)
listview_data = Custom[Listview Data](InputName=code_block, Keys=getParameterValueByName, Values=all_elements_of_category, ShowId_optionnal=boolean)  # package Data-Shapes; Create data for ListView input in UI.MultiInputForm ++ . Check out www.data-shapes.net for more infos.

# group: COLLECT FLOOR TYPES FOR INPUT
code_block_3 = CodeBlock { "Select Floor Type"; }
python_script = Python()  # unwired: IN[0]
# ---------- python_script.python (25 lines) ----------
import clr
import sys
sys.path.append('C:\Program Files (x86)\IronPython 2.7\Lib')
import System
clr.AddReference('RevitNodes')
import Revit
clr.ImportExtensions(Revit.Elements)
clr.AddReference('RevitServices')
import RevitServices
from RevitServices.Persistence import DocumentManager
from RevitServices.Transactions import TransactionManager
clr.AddReference('RevitAPI')
clr.AddReference('RevitAPIUI')
import Autodesk
from Autodesk.Revit.DB import *
from Autodesk.Revit.UI import *

doc = DocumentManager.Instance.CurrentDBDocument
uiapp = DocumentManager.Instance.CurrentUIApplication
app = uiapp.Application
uidoc = uiapp.ActiveUIDocument

element_types = FilteredElementCollector(doc).OfClass(FloorType).ToElements()

OUT = element_types
# ----------------------------------------
code_block_4 = CodeBlock { 0; }
dropdown_data = Custom[DropDown Data](InputName=code_block_3, Keys=python_script, Values=python_script, DefaultValueIndex=code_block_4)  # package Data-Shapes; Create data for DropDown input in UI.MultiInputForm ++ . Check out www.data-shapes.net for more infos.

# group: SET HEIGHT OFFSET INPUT
code_block_5 = CodeBlock { "Height Offset From Level"; }
code_block_6 = CodeBlock { "0"; }
boolean_2 = BoolSelector(true)
textbox_data = Custom[TextBox Data](InputName=code_block_5, DefaultText=code_block_6, IsNumberEntry=boolean_2)  # package Data-Shapes; Create Data for TextBox input in UI.MultipleInputForm ++ . Check out www.data-shapes.net for more informations
floor_types = FloorTypes()  # nothing selected

# group: SET PHASE
code_block_7 = CodeBlock { "Select Phase"; }
phases = Custom[Document.Phases]()  # package Clockwork for Dynamo 2.x; Retrieves all phases in the active document in *chronological* order
code_block_8 = CodeBlock { "Name"; }
getParameterValueByName_2 = Element.GetParameterValueByName(element=phases, parameterName=code_block_8)
python_script_2 = Python(IN[0]=getParameterValueByName_2)
# ---------- python_script_2.python (15 lines) ----------
# Load the Python Standard and DesignScript Libraries
import sys
import clr
clr.AddReference('ProtoGeometry')
from Autodesk.DesignScript.Geometry import *

# The inputs to this node will be stored as a list in the IN variables.
data = IN[0]

if "New Construction" in data:
	out = data.index("New Construction")
else:
	out = 0
	
OUT = out
# ----------------------------------------
dropdown_data_2 = Custom[DropDown Data](InputName=code_block_7, Keys=getParameterValueByName_2, Values=phases, DefaultValueIndex=python_script_2)

# group: SET HEIGHT OFFSET INPUT
code_block_9 = CodeBlock { "Exclude Rooms"; }
code_block_10 = CodeBlock { "Стълби,"; }
boolean_3 = BoolSelector(false)
textbox_data_2 = Custom[TextBox Data](InputName=code_block_9, DefaultText=code_block_10, IsNumberEntry=boolean_3)

# group: COMBINE INPUTS
code_block_11 = CodeBlock { "Floors - Create Including Doors"; }
file_path = Filename("T:\05.ISO\08.LOGO\IPA LOGO\Logo_Ivo Petrov_transperant.png")
code_block_12 = CodeBlock { "Next"; }
list_create = List.Create(item0=listview_data, item1=dropdown_data, item2=textbox_data, item3=dropdown_data_2, item4=textbox_data_2)
inputgroup_data = Custom[InputGroup Data](Inputs=list_create)  # package Data-Shapes; Creates a group of inputs for UI.MultipleInputForm ++ . Check out www.data-shapes.net for more infos !
boolean_4 = BoolSelector(true)
code_block_13 = CodeBlock { "Cancel"; 600; }
multipleinputform = Custom[MultipleInputForm ++](Description_optional=code_block_11, Logo_optional=file_path, ButtonText_optional=code_block_12, Inputs=inputgroup_data, Toggle=boolean_4, CancelButtonText_optional=code_block_13.out0, Width_optional=code_block_13.out1)  # package Data-Shapes; Create a form with multiple inputs. see www.data-shapes.net for tutorials and infos!
watch = Watch(multipleinputform.User_Inputs)

# group: FILTER ROOMS BY LEVEL AND DOORS BY ROOMS
code_block_14 = CodeBlock { 0; }
getItemAtIndex = List.GetItemAtIndex(list=watch, index=code_block_14)
flatten = List.Flatten(list=getItemAtIndex)
get_rooms_by_level = Custom[Get Rooms by Level](level=flatten, lacing=Longest)  # package archi-lab.net; Filters Rooms by level.
watch_2 = Watch(get_rooms_by_level.room)
flatten_2 = List.Flatten(list=watch_2)
code_block_15 = CodeBlock { 3; }
getItemAtIndex_2 = List.GetItemAtIndex(list=watch, index=code_block_15)
doors = Custom[Room.Doors](room=get_rooms_by_level.room, phase=getItemAtIndex_2)  # package Clockwork for Dynamo 2.x; Retrieves all doors that are associated with a room (hosted in walls and roofs).
flatten_3 = List.Flatten(list=doors)
uniqueItems = List.UniqueItems(list=flatten_3)
getHost = FamilyInstance.GetHost(familyInstance=uniqueItems)

# group: FILTER OUT UNPLACED ROOMS
area = Room.Area(room=flatten_2)
code_block_16 = CodeBlock { 0; }
eq = Equals(x=area, y=code_block_16)
filterByBoolMask = List.FilterByBoolMask(list=flatten_2, mask=eq)

# group: EXCLUDE SPECIFIC ROOMS
code_block_17 = CodeBlock { "Name"; }
getParameterValueByName_3 = Element.GetParameterValueByName(element=filterByBoolMask.out, parameterName=code_block_17)
code_block_18 = CodeBlock { 4; }
getItemAtIndex_3 = List.GetItemAtIndex(list=watch, index=code_block_18)
python_script_3 = Python(IN[0]=getParameterValueByName_3, IN[1]=getItemAtIndex_3)
# ---------- python_script_3.python (28 lines) ----------
# Load the Python Standard and DesignScript Libraries
import sys
import clr
clr.AddReference('ProtoGeometry')
from Autodesk.DesignScript.Geometry import *

# The inputs to this node will be stored as a list in the IN variables.
exclude_words = IN[1]
names = IN[0]
outlist = []

if not exclude_words == "":
	exclude_words = list(filter(None,exclude_words.Split(",")))
	for item in names:
		flag = False
		for word in exclude_words:
			if word.lower() in item.lower():
				flag = True
				break
		if flag:
			outlist.append(True)
		else:
			outlist.append(False)
else:
	for item in IN[0]:
		outlist.append(False)

OUT = outlist
# ----------------------------------------
filterByBoolMask_2 = List.FilterByBoolMask(list=filterByBoolMask.out, mask=python_script_3)

# group: GET OUTLINES FOR ROOMS
finishBoundary = Room.FinishBoundary(room=filterByBoolMask_2.out)
startPoint = Curve.StartPoint(curve=finishBoundary)
code_block_19 = CodeBlock { true; }
byPoints = PolyCurve.ByPoints(points=startPoint, connectLastToFirst=code_block_19)
flatten_4 = List.Flatten(list=byPoints)

check_room_bounding = Python(IN[0]=getHost)
# ---------- check_room_bounding.python (43 lines) ----------
import clr
import sys
sys.path.append('C:\Program Files (x86)\IronPython 2.7\Lib')
import System
from System import Array
from System.Collections.Generic import *
clr.AddReference('ProtoGeometry')
from Autodesk.DesignScript.Geometry import *
clr.AddReference("RevitNodes")
import Revit
clr.ImportExtensions(Revit.Elements)
clr.ImportExtensions(Revit.GeometryConversion)
clr.AddReference("RevitServices")
import RevitServices
from RevitServices.Persistence import DocumentManager 
from RevitServices.Transactions import TransactionManager 

clr.AddReference("RevitAPI")
clr.AddReference("RevitAPIUI")

import Autodesk 
from Autodesk.Revit.DB import *
from Autodesk.Revit.UI import *

doc = DocumentManager.Instance.CurrentDBDocument
uiapp = DocumentManager.Instance.CurrentUIApplication 
app = uiapp.Application 
uidoc = uiapp.ActiveUIDocument

# The inputs to this node will be stored as a list in the IN variables.
walls = IN[0]
outlist = []

for wall in walls:
	wall = UnwrapElement(wall)
	wall_check = wall.get_Parameter(BuiltInParameter.WALL_ATTR_ROOM_BOUNDING).AsInteger()
	if wall_check == 1:
		outlist.append(True)
	else:
		outlist.append(False)

# Assign your output to the OUT variable.
OUT = outlist
# ----------------------------------------
filterByBoolMask_3 = List.FilterByBoolMask(list=uniqueItems, mask=check_room_bounding)
filterByBoolMask_4 = List.FilterByBoolMask(list=getHost, mask=check_room_bounding)

# group (continued): FILTER ROOMS BY LEVEL AND DOORS BY ROOMS
ꟿ_wall_iscurtainwall = Custom[ꟿ Wall.IsCurtainWall](wall=filterByBoolMask_4.in)  # package spring nodes; Returns true if the wall is a curtain wall.
filterByBoolMask_5 = List.FilterByBoolMask(list=filterByBoolMask_3.in, mask=ꟿ_wall_iscurtainwall)
watch_3 = Watch(filterByBoolMask_5.out)
getLocation = Element.GetLocation(element=watch_3)
facingOrientation = FamilyInstance.FacingOrientation(familyInstance=watch_3)
python_script_4 = Python(IN[0]=watch_3)
# ---------- python_script_4.python (53 lines) ----------
import clr
import sys
sys.path.append('C:\Program Files (x86)\IronPython 2.7\Lib')
import System
from System import Array
from System.Collections.Generic import *
clr.AddReference('ProtoGeometry')
from Autodesk.DesignScript.Geometry import *
clr.AddReference("RevitNodes")
import Revit
clr.ImportExtensions(Revit.Elements)
clr.ImportExtensions(Revit.GeometryConversion)
clr.AddReference("RevitServices")
import RevitServices
from RevitServices.Persistence import DocumentManager
from RevitServices.Transactions import TransactionManager

clr.AddReference("RevitAPI")
clr.AddReference("RevitAPIUI")

import Autodesk
from Autodesk.Revit.DB import *
from Autodesk.Revit.UI import *

doc = DocumentManager.Instance.CurrentDBDocument
uiapp = DocumentManager.Instance.CurrentUIApplication
app = uiapp.Application
uidoc = uiapp.ActiveUIDocument

#######OK NOW YOU CAN CODE########
# The inputs to this node will be stored as a list in the IN variables.

door_instances = IN[0]
outlist = []

for instance in door_instances:
	instance = UnwrapElement(instance)
	instance_id = instance.GetTypeId()
	family_type = doc.GetElement(instance_id)
	try:
		width_param = family_type.LookupParameter("Width")
		param_val = width_param.AsValueString()
		if param_val == "0":
			width_param = family_type.LookupParameter("D Product Width")
			param_val = width_param.AsValueString()
		outlist.append(int(param_val))
	except:
		width_param = instance.LookupParameter("Width")
		param_val = width_param.AsValueString()
		outlist.append(int(param_val))

# Assign your output to the OUT variable.
OUT = outlist
# ----------------------------------------

# group: DOOR INFILL
ZAxis = Vector.ZAxis()
code_block_20 = CodeBlock(w=python_script_4) { w/2; 90; }
rotate = Vector.Rotate(vector=facingOrientation, axis=ZAxis, degrees=code_block_20.out1)
translate = Geometry.Translate(geometry=getLocation, direction=rotate, distance=code_block_20.out0)
reverse = Vector.Reverse(vector=rotate)
translate_2 = Geometry.Translate(geometry=translate, direction=reverse, distance=python_script_4)
byStartPointEndPoint = Line.ByStartPointEndPoint(startPoint=translate, endPoint=translate_2)
getHost_2 = FamilyInstance.GetHost(familyInstance=watch_3)
elementType = Element.ElementType(element=getHost_2)
string = StringInput("Width")
getParameterValueByName_4 = Element.GetParameterValueByName(element=elementType, parameterName=string)
ZAxis_2 = Vector.ZAxis()
byThickeningCurve = PolyCurve.ByThickeningCurve(curve=byStartPointEndPoint, thickness=getParameterValueByName_4, nor=ZAxis_2)

# group: GET OUTLINES FOR ROOMS AND DOORS
watch_4 = Watch(filterByBoolMask_2.out)
watch_5 = Watch(watch_3)
rooms = Custom[Door.Rooms](door=watch_5, phase=getItemAtIndex_2)  # package Clockwork for Dynamo 2.x; Gets the rooms that are connected by a given door
watch_6 = Watch(rooms.fromRoom)
indexOf = List.IndexOf(list=watch_4, element=watch_6)
python_script_5 = Python(IN[0]=byPoints, IN[1]=byThickeningCurve, IN[2]=indexOf)
# ---------- python_script_5.python (17 lines) ----------
# Load the Python Standard and DesignScript Libraries
import sys
import clr
clr.AddReference('ProtoGeometry')
from Autodesk.DesignScript.Geometry import *

# The inputs to this node will be stored as a list in the IN variables.
rooms = IN[0]
doors = IN[1]
indexes = IN[2]
outlist = []

for i, item in enumerate(indexes):
	rooms[item].append(doors[i])


OUT = rooms
# ----------------------------------------
byPatch = Surface.ByPatch(closedCurve=python_script_5)
byJoinedSurfaces = PolySurface.ByJoinedSurfaces(surfaces=byPatch@L2)
perimeterCurves = Surface.PerimeterCurves(surface=byJoinedSurfaces)
byJoinedCurves = PolyCurve.ByJoinedCurves(curves=perimeterCurves)

# group: WINDOW INFILL
windows = Custom[Room.Windows](room=get_rooms_by_level.room, phase=getItemAtIndex_2)  # package Clockwork for Dynamo 2.x; Retrieves all windows that are associated with a room (hosted in walls and roofs).
flatten_5 = List.Flatten(list=windows)
code_block_21 = CodeBlock { "Sill Height"; }
getParameterValueByName_5 = Element.GetParameterValueByName(element=flatten_5, parameterName=code_block_21)
code_block_22 = CodeBlock { 0; }
code_block_23 = CodeBlock { 0.1; }
eq_2 = Equals(x=getParameterValueByName_5, y=code_block_22, tolerance=code_block_23)
filterByBoolMask_6 = List.FilterByBoolMask(list=flatten_5, mask=eq_2)
watch_7 = Watch(filterByBoolMask_6.in)
getLocation_2 = Element.GetLocation(element=watch_7)
facingOrientation_2 = FamilyInstance.FacingOrientation(familyInstance=watch_7)
ZAxis_3 = Vector.ZAxis()
elementType_2 = Element.ElementType(element=watch_7)
string_2 = StringInput("Width")
getParameterValueByName_6 = Element.GetParameterValueByName(element=elementType_2, parameterName=string_2)
code_block_24 = CodeBlock(w=getParameterValueByName_6) { w/2; 90; }
rotate_2 = Vector.Rotate(vector=facingOrientation_2, axis=ZAxis_3, degrees=code_block_24.out1)
translate_3 = Geometry.Translate(geometry=getLocation_2, direction=rotate_2, distance=code_block_24.out0)
reverse_2 = Vector.Reverse(vector=rotate_2)
translate_4 = Geometry.Translate(geometry=translate_3, direction=reverse_2, distance=getParameterValueByName_6)
byStartPointEndPoint_2 = Line.ByStartPointEndPoint(startPoint=translate_3, endPoint=translate_4)
getHost_3 = FamilyInstance.GetHost(familyInstance=watch_7)
elementType_3 = Element.ElementType(element=getHost_3)
string_3 = StringInput("Width")
getParameterValueByName_7 = Element.GetParameterValueByName(element=elementType_3, parameterName=string_3)
ZAxis_4 = Vector.ZAxis()
byThickeningCurve_2 = PolyCurve.ByThickeningCurve(curve=byStartPointEndPoint_2, thickness=getParameterValueByName_7, nor=ZAxis_4)

# group: CHECK WINDOWS AGAINST ROOMS
flatten_6 = List.Flatten(list=byJoinedCurves)
isNull = Object.IsNull(obj=flatten_6)
if_ = If(test=isNull, true=flatten_4, false=flatten_6)
doesIntersect = Geometry.DoesIntersect(geometry=if_, other=byThickeningCurve_2, lacing=CrossProduct)
code_block_25 = CodeBlock { true; }
allIndicesOf = List.AllIndicesOf(list=doesIntersect, item=code_block_25, lacing=Longest)
getItemAtIndex_4 = List.GetItemAtIndex(list=byThickeningCurve_2@@L2, index=allIndicesOf, lacing=Longest)

# group: CREATE SURFACES AND EXTRACT PERIMETER CURVES
byPatch_2 = Surface.ByPatch(closedCurve=if_, lacing=Longest)
byPatch_3 = Surface.ByPatch(closedCurve=getItemAtIndex_4@@L2, lacing=Longest)

python_script_6 = Python(IN[0]=byPatch_2, IN[1]=byPatch_3)
# ---------- python_script_6.python (29 lines) ----------
# Load the Python Standard and DesignScript Libraries
import sys
import clr
clr.AddReference('ProtoGeometry')
from Autodesk.DesignScript.Geometry import *

# The inputs to this node will be stored as a list in the IN variables.
list1 = IN[0]
list2 = IN[1]

# Place your code below this line

outlist = []
i = 0

for elem in list1:
	sublist = []
	if elem != None:
		sublist.append(elem)
	if list2[i]:
		for subelem in list2[i]:
			sublist.append(subelem)
	outlist.append(sublist)
	i += 1


# Assign your output to the OUT variable.

OUT = outlist
# ----------------------------------------

# group (continued): CREATE SURFACES AND EXTRACT PERIMETER CURVES
isEmpty = List.IsEmpty(list=python_script_6@@L2)
filterByBoolMask_7 = List.FilterByBoolMask(list=python_script_6, mask=isEmpty)
byUnion = Surface.ByUnion(surfaces=filterByBoolMask_7.out@@L2, lacing=Longest)
perimeterCurves_2 = Surface.PerimeterCurves(surface=byUnion)
length = Curve.Length(curve=perimeterCurves_2)
python_script_7 = Python(IN[0]=length, IN[1]=perimeterCurves_2)
# ---------- python_script_7.python (24 lines) ----------
# Load the Python Standard and DesignScript Libraries
import sys
import clr
clr.AddReference('ProtoGeometry')
from Autodesk.DesignScript.Geometry import *

# The inputs to this node will be stored as a list in the IN variables.
lengths = IN[0]
curves = IN[1]
outlist = []

for index, length in enumerate(lengths):
	templist = []
	try:
		for index2, value in enumerate(length):
			if value > 0.05:
				templist.append(curves[index][index2])
		outlist.append(templist)
	except:
		pass
	

# Assign your output to the OUT variable.
OUT = outlist
# ----------------------------------------
byJoinedCurves_2 = PolyCurve.ByJoinedCurves(curves=python_script_7)

# group: GET LEVELS, FLOOR TYPE AND OFFSET
code_block_26 = CodeBlock { 1; }
getItemAtIndex_5 = List.GetItemAtIndex(list=watch, index=code_block_26)
code_block_27 = CodeBlock { "Level"; }
getParameterValueByName_8 = Element.GetParameterValueByName(element=filterByBoolMask_2.out, parameterName=code_block_27)
byName = WombatDynamo.Level.ByName(name=getParameterValueByName_8)
code_block_28 = CodeBlock { 2; }
getItemAtIndex_6 = List.GetItemAtIndex(list=watch, index=code_block_28)

# group: CREATE FLOORS AND SET OFFSET
byOutlineTypeAndLevel = Floor.ByOutlineTypeAndLevel(outline=byJoinedCurves_2, floorType=getItemAtIndex_5, level=byName)
code_block_29 = CodeBlock { "Height Offset From Level"; }
setParameterByName = Element.SetParameterByName(element=byOutlineTypeAndLevel, parameterName=code_block_29, value=getItemAtIndex_6)

# group: LOG FILE DUMP
feedback_time_saved_h = DoubleSlider(1, range=0..1000 step 0.1)
feedback_testing = BoolSelector(false)
logExporter = Custom[LogExporter](Time_Saved=feedback_time_saved_h, Testing=feedback_testing)  # frozen; package IPArchitects

# group: CREATED FLOORS
created_floors = Watch(byOutlineTypeAndLevel)  # graph output

# group: COMPARE CREATED FLOORS TO ROOMS
watch_8 = Watch(filterByBoolMask_2.out)  # frozen
python_script_8 = Python(IN[0]=watch_8, IN[1]=created_floors)
# ---------- python_script_8.python (16 lines) ----------
# Load the Python Standard and DesignScript Libraries
import sys
import clr
clr.AddReference('ProtoGeometry')
from Autodesk.DesignScript.Geometry import *

rooms = IN[0]
floors = IN[1]
outlist = []

for floor, index in enumerate(floors):
	if floor == None:
		outlist.append(rooms[index])


OUT = outlist
# ----------------------------------------

# group: UNRESOLVED ROOMS
unresolved_rooms = Watch(python_script_8)  # graph output
