# Dynamo graph Floors - Change Floor Type by Room_script.dyn "Floors - Change Floor Type by Room" (Dynamo 2.6.2.15705)
# packages: Rhythm 2020.7.25, Clockwork for Dynamo 2.x 2.3.0, Data-Shapes 2021.2.91, IPArchitects 0.0.1, Synthesize toolkit 11.7.5

code_block = CodeBlock { 20; }
categories = Categories("OST_Floors")
all_elements_of_category = ElementsOfCategory(Category=categories)
code_block_2 = CodeBlock { "Level"; }
getParameterValueByName = Element.GetParameterValueByName(element=all_elements_of_category, parameterName=code_block_2)
code_block_3 = CodeBlock { "Name"; }
getParameterValueByName_2 = Element.GetParameterValueByName(element=getParameterValueByName, parameterName=code_block_3)

# group: COLLECT LEVELS FOR INPUT
code_block_4 = CodeBlock { "Select Levels"; }
categories_2 = Categories("OST_Levels")
all_elements_of_category_2 = ElementsOfCategory(Category=categories_2)
code_block_5 = CodeBlock { "Name"; }
getParameterValueByName_3 = Element.GetParameterValueByName(element=all_elements_of_category_2, parameterName=code_block_5)
boolean = BoolSelector(false)
listview_data = Custom[Listview Data](InputName=code_block_4, Keys=getParameterValueByName_3, Values=all_elements_of_category_2, ShowId_optionnal=boolean)  # package Data-Shapes; Create data for ListView input in UI.MultiInputForm ++ . Check out www.data-shapes.net for more infos.

# group: COLLECT FLOOR TYPES FOR INPUT
code_block_6 = CodeBlock { "Select Floor Type"; }
python_script = Python()  # unwired: IN[0]
# ---------- python_script.python (25 lines) ----------
import clr
import sys
sys.path.append('C:\Program Files (x86)\IronPython 2.7\Lib')
import System
clr.AddReference('RevitNodes')
import Revit
clr.ImportExtensions(Revit.Elements)
clr.AddReference('RevitServices')
import RevitServices
from RevitServices.Persistence import DocumentManager
from RevitServices.Transactions import TransactionManager
clr.AddReference('RevitAPI')
clr.AddReference('RevitAPIUI')
import Autodesk
from Autodesk.Revit.DB import *
from Autodesk.Revit.UI import *

doc = DocumentManager.Instance.CurrentDBDocument
uiapp = DocumentManager.Instance.CurrentUIApplication
app = uiapp.Application
uidoc = uiapp.ActiveUIDocument

element_types = FilteredElementCollector(doc).OfClass(FloorType).ToElements()

OUT = element_types
# ----------------------------------------
code_block_7 = CodeBlock { 1; }
dropdown_data = Custom[DropDown Data](InputName=code_block_6, Keys=python_script, Values=python_script, DefaultValueIndex=code_block_7)  # package Data-Shapes; Create data for DropDown input in UI.MultiInputForm ++ . Check out www.data-shapes.net for more infos.

# group: SET ROOMS TO LOOK FOR
code_block_8 = CodeBlock { "Search Rooms"; }
code_block_9 = CodeBlock { ""; }
boolean_2 = BoolSelector(false)
textbox_data = Custom[TextBox Data](InputName=code_block_8, DefaultText=code_block_9, IsNumberEntry=boolean_2)  # package Data-Shapes; Create Data for TextBox input in UI.MultipleInputForm ++ . Check out www.data-shapes.net for more informations

# group: COMBINE INPUTS
code_block_10 = CodeBlock { "Floors - Create Including Doors"; }
file_path = Filename("T:\05.ISO\08.LOGO\IPA LOGO\Logo_Ivo Petrov_transperant.png")
code_block_11 = CodeBlock { "Next"; }
list_create = List.Create(item0=listview_data, item1=dropdown_data, item2=textbox_data)
inputgroup_data = Custom[InputGroup Data](Inputs=list_create)  # package Data-Shapes; Creates a group of inputs for UI.MultipleInputForm ++ . Check out www.data-shapes.net for more infos !
boolean_3 = BoolSelector(true)
code_block_12 = CodeBlock { "Cancel"; 600; }
multipleinputform = Custom[MultipleInputForm ++](Description_optional=code_block_10, Logo_optional=file_path, ButtonText_optional=code_block_11, Inputs=inputgroup_data, Toggle=boolean_3, CancelButtonText_optional=code_block_12.out0, Width_optional=code_block_12.out1)  # package Data-Shapes; Create a form with multiple inputs. see www.data-shapes.net for tutorials and infos!
watch = Watch(multipleinputform.User_Inputs)

code_block_13 = CodeBlock { 0; }
getItemAtIndex = List.GetItemAtIndex(list=watch, index=code_block_13)
code_block_14 = CodeBlock { "Name"; }
getParameterValueByName_4 = Element.GetParameterValueByName(element=getItemAtIndex, parameterName=code_block_14)
python_script_2 = Python(IN[0]=getParameterValueByName_2, IN[1]=getParameterValueByName_4)
# ---------- python_script_2.python (34 lines) ----------
import clr
import sys
sys.path.append('C:\Program Files (x86)\IronPython 2.7\Lib')
import System
from System import Array
from System.Collections.Generic import *
clr.AddReference('ProtoGeometry')
from Autodesk.DesignScript.Geometry import *
clr.AddReference("RevitNodes")
import Revit
clr.ImportExtensions(Revit.Elements)
clr.ImportExtensions(Revit.GeometryConversion)
clr.AddReference("RevitServices")
import RevitServices
from RevitServices.Persistence import DocumentManager
from RevitServices.Transactions import TransactionManager

clr.AddReference("RevitAPI")
clr.AddReference("RevitAPIUI")

import Autodesk
from Autodesk.Revit.DB import *
from Autodesk.Revit.UI import *

#######OK NOW YOU CAN CODE########
outlist = []

for item in IN[0]:
	if item in IN[1]:
		outlist.append(True)
	else:
		outlist.append(False)
		
OUT = outlist
# ----------------------------------------
filterByBoolMask = List.FilterByBoolMask(list=all_elements_of_category, mask=python_script_2)
watch_2 = Watch(filterByBoolMask.in)
original = Custom[SP.Collector.ElementSketch.Original](VARelement=filterByBoolMask.in)  # package Synthesize toolkit; Get the actual sketch lines of a sketch based element (floor, ceiling, modified wall, etc.) . You can optionally fetch the matching model curves, however this might prove comptationally heavy on larger data sets. Does not work with elements from linked files.
watch_3 = Watch(original.VARcurves)
byJoinedCurves = PolyCurve.ByJoinedCurves(curves=watch_3)
byPatch = Surface.ByPatch(closedCurve=byJoinedCurves)
flatten = List.Flatten(list=byPatch)
categories_3 = Categories("OST_Rooms")
all_elements_of_category_3 = ElementsOfCategory(Category=categories_3)
code_block_15 = CodeBlock { "Name"; }
getParameterValueByName_5 = Element.GetParameterValueByName(element=all_elements_of_category_3, parameterName=code_block_15)
code_block_16 = CodeBlock { 2; }
getItemAtIndex_2 = List.GetItemAtIndex(list=watch, index=code_block_16)
contains = String.Contains(str=getParameterValueByName_5, searchFor=getItemAtIndex_2)
filterByBoolMask_2 = List.FilterByBoolMask(list=all_elements_of_category_3, mask=contains)
code_block_17 = CodeBlock { "Level"; }
getParameterValueByName_6 = Element.GetParameterValueByName(element=filterByBoolMask_2.in, parameterName=code_block_17)
python_script_3 = Python(IN[0]=getParameterValueByName_6, IN[1]=getParameterValueByName_4)  # same code as python_script_2
filterByBoolMask_3 = List.FilterByBoolMask(list=filterByBoolMask_2.in, mask=python_script_3)
watch_4 = Watch(filterByBoolMask_3.in)
ʳʰʸᵗʰᵐ_rooms_centerroom = Rhythm.Revit.Elements.Rooms.CenterRoom(room=watch_4)
location = Room.Location(room=ʳʰʸᵗʰᵐ_rooms_centerroom)
ZAxis = Vector.ZAxis()
code_block_18 = CodeBlock { -50; }
byStartPointDirectionLength = Line.ByStartPointDirectionLength(startPoint=location, direction=ZAxis, length=code_block_18)
doesIntersect = Geometry.DoesIntersect(geometry=flatten, other=byStartPointDirectionLength, lacing=CrossProduct)
anyTrue = Custom[Booleans.AnyTrue](seq=doesIntersect)  # package Clockwork for Dynamo 2.x; Returns true if any item in a list of booleans is true.
filterByBoolMask_4 = List.FilterByBoolMask(list=watch_2, mask=anyTrue)
watch_5 = Watch(filterByBoolMask_4.in)
code_block_19 = CodeBlock { "Type"; }
getParameterValueByName_7 = Element.GetParameterValueByName(element=watch_5, parameterName=code_block_19)
code_block_20 = CodeBlock { 1; }
getItemAtIndex_3 = List.GetItemAtIndex(list=watch, index=code_block_20)
watch_6 = Watch(getItemAtIndex_3)
setParameterByName = Element.SetParameterByName(element=watch_5, parameterName=code_block_19, value=watch_6)

# group: LOG FILE DUMP
feedback_time_saved_h = DoubleSlider(1, range=0..1000 step 0.1)
feedback_testing = BoolSelector(false)
logExporter = Custom[LogExporter](Time_Saved=feedback_time_saved_h, Testing=feedback_testing)  # frozen; package IPArchitects
